# Dynamo graph ExampleFile.dyn (Dynamo 2.12.0.5650)
# packages: DynExcel 1.0.0

file_path = Filename("C:\Users\BIA97506\Mott MacDonald\Sydney Computational Design Team - Documents\ExcelReaderAndWriter\test sheets\20170208 371138 Core Walls.xlsm")
file_path_2 = Filename("C:\Users\BIA97506\Mott MacDonald\Sydney Computational Design Team - Documents\ExcelReaderAndWriter\test sheets\Haven Lateral calculation.csv")
file_path_3 = Filename("C:\Users\BIA97506\Mott MacDonald\Sydney Computational Design Team - Documents\ExcelReaderAndWriter\test sheets\Haven Lateral calculation.xls")
python_script = Python()  # CPython3; unwired: IN[0]
# ---------- python_script.python (3 lines) ----------
# Load the Python Standard and DesignScript Libraries
import os
OUT = os.path.join(os.path.join(os.environ['USERPROFILE']), 'Desktop') 
# ----------------------------------------
code_block = CodeBlock { "TestFile"; "SheetName"; ["ID", "Shape", "Area"]; }
code_block_2 = CodeBlock()
# ---------- code_block_2.designscript (3 lines) ----------
[["001", "003", "004"],
["Triangle", "Square", "Circle"],
[10, 50, 60]];
# ----------------------------------------
boolean = BoolSelector(false)
excel = DynExcel.Writer.Excel(path=python_script, fileName=code_block.out0, sheetName=code_block.out1, headers=code_block.out2, data=code_block_2, save=boolean)
file_path_4 = Filename("..\..\..\..\..\..\Mott MacDonald\Sydney Computational Design Team - Documents\02_Tools\003_ExcelReaderAndWriter\test sheets\AS4100 - Steel bending custom sections.xlsx")
code_block_3 = CodeBlock { "T-Section"; ["T-Section","Custom Section"]; 0; [0,1]; "A0:B5"; }
sheetData = DynExcel.Reader.SheetData(filePath=file_path_4, sheet=code_block_3.out2)
sheetNames = DynExcel.Reader.SheetNames(filePath=file_path_4)
